# Grasshopper definition ShareBricks.gh (Grasshopper 0.9.76)

# To share your bricks:
# 1. Get your BrickBox content with the "Get" component.
# 2. Internalize it in "BrickBox data".
# 3. Save the "BrickBox data" component to a new file.
# 4. Share that file with whoever you want.
# 
# To load others bricks:
# 1. Ask for the file with the component "BrickBox data".
# 2. Copy and paste it into this file.
# 3. Plug it into the "Set" component.
# 4. Restart Rhino and Grasshopper.
set = CSharpScript()
# ---------- set: C# ----------
    Dictionary<string,string> dic = (Dictionary<string,string>) D;
    if(dic == null)return;
    GH_SettingsServer server = Grasshopper.Instances.Settings;
    foreach(KeyValuePair<string,string> kv in dic){
      string key = kv.Key;
      string val = kv.Value;
      if(server.ConstainsEntry(key)){
        //string m = "The brick " + key + " has been discarded because this box already contains a brick with that name";
        //Print(m);
      }else{
        Print("Added: " + key);
        server.SetValue(key, val);
      }
    }
# ---------- end set ----------
get = CSharpScript()  # -> D
# ---------- get: C# ----------
    Dictionary<string,string> dic = new Dictionary<string,string>();
    GH_SettingsServer server = Grasshopper.Instances.Settings;
    List<string> names = server.EntryNames();
    foreach(string n in names)
      if(n.StartsWith("BrickBox."))
        dic.Add(n, server.GetValue(n, string.Empty));
    
    D = new GH_ObjectWrapper(dic);
# ---------- end get ----------

# ---- group: Internalize and share
brickbox_data = Data(get)
